# Grasshopper definition temp_01.gh (Grasshopper 1.0.7)

python = GhPythonScript(OPEN_REPO=Button())  # -> out, a; inputs OPEN_REPO: Boolean
# ---------- python: Python ----------
import System
import webbrowser
import clr

URL = "https://github.com/Andrupavlov/GHDoc-temp"

def open_url_in_thread(url):
    def thread_func():
        webbrowser.open(url)
    t = System.Threading.Thread(System.Threading.ThreadStart(thread_func))
    t.IsBackground = True
    t.Start()

if OPEN_REPO:
    open_url_in_thread(URL)
# ---------- end python ----------
python_2 = GhPythonScript()  # -> out, a
# ---------- python_2: Python ----------
import os

def get_gh_filename():
    """
    Повертає ім'я поточного Grasshopper-файлу без розширення.
    Якщо файл не збережений — повертає None.
    """
    doc = ghenv.Component.OnPingDocument()
    file_path = doc.FilePath

    if not file_path:
        return None

    file_name = os.path.basename(file_path)
    name_without_ext = os.path.splitext(file_name)[0]
    return name_without_ext

# Використання
a = get_gh_filename()
# ---------- end python_2 ----------
panel = Panel(python_2.a)
